# Grasshopper definition Final_kangaroo2simulation.gh (Grasshopper 1.0.8)
# plug-ins: Anemone, Excel, Kangaroo2 Components, WSFinder

# ----
# 编织结构1半球形
s1 = SubD(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)
mesh = MeshBrep(
    Brep=s1,
    Settings={GridMaxCount=0, GridMinCount=16, JaggedSeams=False, MaxEdgeLength=0, MinEdgeLength=0.0001, MinTolerance=0, Refine=True, RefineAngle=0, RelativeTolerance=0.65, SimplePlanes=True, Tolerance=0})
triremesh = TriRemesh(Geometry=mesh, Length=Slider(2.6, range=0..10), Iterations=Slider(27, range=0..100))  # -> Triangulation, Dual, Creases
mesh_2 = Mesh(triremesh.Triangulation)
setinputdata = SetInputData(Mesh=triremesh.Triangulation, VerticesCount=Slider(35, range=0..100))
pointspacking = PointsPacking(WeavingData=setinputdata)
meshfrompoints = MeshFromPoints(WeavingData=pointspacking, Refine=True, AdjustEdge=True, Project=True)  # -> WeavingData, Mesh, AverageLength
kagomemesh = KagomeMesh(WeavingData=meshfrompoints.WeavingData, Smooth=True)  # -> WeavingData, KagomeMesh, EdgeLines, InverseKagomeMesh, DataMesh
kagomemeshtopolylines = KagomeMeshToPolylines(WeavingData=kagomemesh.WeavingData, KagomeMesh=kagomemesh.KagomeMesh, Subs=1)  # -> WeavingData, Polylines

# ----
# 编织结构3 三通
s3 = SubD(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)
mesh_3 = MeshBrep(
    Brep=s3,
    Settings={GridMaxCount=0, GridMinCount=16, JaggedSeams=False, MaxEdgeLength=0, MinEdgeLength=0.0001, MinTolerance=0, Refine=True, RefineAngle=0, RelativeTolerance=0.65, SimplePlanes=True, Tolerance=0})
triremesh_2 = TriRemesh(Geometry=mesh_3, Length=Slider(6, range=0..10), Iterations=Slider(20, range=0..100))  # -> Triangulation, Dual, Creases
setinputdata_2 = SetInputData(Mesh=triremesh_2.Triangulation, VerticesCount=Slider(28, range=0..100))
pointspacking_2 = PointsPacking(WeavingData=setinputdata_2)
meshfrompoints_2 = MeshFromPoints(WeavingData=pointspacking_2, Refine=True, AdjustEdge=True, Project=True)  # -> WeavingData, Mesh, AverageLength
kagomemesh_2 = KagomeMesh(WeavingData=meshfrompoints_2.WeavingData, Mesh=meshfrompoints_2.Mesh, Smooth=True)  # -> WeavingData, KagomeMesh, EdgeLines, InverseKagomeMesh, DataMesh
kagomemeshtopolylines_2 = KagomeMeshToPolylines(WeavingData=kagomemesh_2.WeavingData, KagomeMesh=kagomemesh_2.KagomeMesh, Subs=1)  # -> WeavingData, Polylines

s2_马鞍面 = Geometry(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)
pt = Point([Point(0, 0, 0), Point(-0.4258752683, -0.5611478575, 0), Point(-1.783979143, 1.228336379, 0), Point(-1.358103874, 1.789484236, 0)])

# ----
# 编织结构2 马鞍面
mesh_4 = MeshBrep(
    Brep=s2_马鞍面,
    Settings={GridMaxCount=0, GridMinCount=16, JaggedSeams=False, MaxEdgeLength=0, MinEdgeLength=0.0001, MinTolerance=0, Refine=True, RefineAngle=0, RelativeTolerance=0.65, SimplePlanes=True, Tolerance=0})
triremesh_3 = TriRemesh(Geometry=mesh_4, Length=Slider(9, range=0..10), Iterations=Slider(16, range=0..100))  # -> Triangulation, Dual, Creases
setinputdata_3 = SetInputData(Mesh=triremesh_3.Triangulation, SharpPoints=pt, VerticesCount=Slider(15, range=0..100))
pointspacking_3 = PointsPacking(WeavingData=setinputdata_3)
meshfrompoints_3 = MeshFromPoints(WeavingData=pointspacking_3, Refine=True, AdjustEdge=True, Project=True)  # -> WeavingData, Mesh, AverageLength
kagomemesh_3 = KagomeMesh(WeavingData=meshfrompoints_3.WeavingData, Mesh=meshfrompoints_3.Mesh, Smooth=True)  # -> WeavingData, KagomeMesh, EdgeLines, InverseKagomeMesh, DataMesh
kagomemeshtopolylines_3 = KagomeMeshToPolylines(WeavingData=kagomemesh_3.WeavingData, KagomeMesh=kagomemesh_3.KagomeMesh, Subs=1)  # -> WeavingData, Polylines

relaxation = Relaxation(relay=kagomemeshtopolylines.Polylines)
relaxation_2 = Relaxation(relay=kagomemeshtopolylines_2.Polylines)
relaxation_3 = Relaxation(relay=kagomemeshtopolylines_3.Polylines)
toggle = BooleanToggle(False)
lng = ListLength(List=relaxation)
panel = Panel("""0
2
7
1
6
3
5
4""")
toggle_2 = BooleanToggle(True)
panel_2 = Panel("""2
4
3
0
1
8
5
7
14
9
6
10
13
11
15
12""")
toggle_3 = BooleanToggle(False)
lng_2 = ListLength(List=relaxation_2)
lng_3 = ListLength(List=relaxation_3)
multiplication = Multiplication(A=Slider(100, range=0..100), B=lng)
lng_4 = ListLength(List=relaxation)
panel_3 = Panel("""2
4
3
0
1
8
5
6
14
13
9
7
12
10
11
15""")
loop_start = LoopStart(Repeat=multiplication, Trigger=toggle, Data="-1")  # -> port, Counter, Data
# Validation
rev = ReverseList(List=panel)
addition = Addition(A=loop_start.Data, B="1")
multiplication_2 = Multiplication(A=Slider(100, range=0..100), B=lng_3)
multiplication_3 = Multiplication(A=Slider(10, range=0..100), B=lng_4)
loop_start_2 = LoopStart(Repeat=multiplication_2, Trigger=toggle_2, Data="-1")  # -> port, Counter, Data
loop_end = LoopEnd(port=loop_start.port, Exit=toggle, Data=addition, TimeOutVal=0, pausedState=False, state="Constant output")
loop_start_3 = LoopStart(Repeat=multiplication_3, Trigger=toggle_3, Data="-1")  # -> port, Counter, Data
panel_4 = Panel("""10
8
12
6
5
14
4
1
2
3
11
0
7
9
13
15""")
lng_5 = ListLength(List=relaxation)
addition_2 = Addition(A=loop_start_2.Data, B="1")
addition_3 = Addition(A=loop_start_3.Data, B="1")
series = Series(Start=0, Step=1, Count=lng)
panel_5 = Panel(loop_end)
division = Division(A=panel_5, B=lng)
mod = Modulus(A=panel_5, B=lng)
round = Round(Number=division)  # -> Nearest, Floor, Ceiling
lng_6 = ListLength(List=relaxation_2)
series_2 = Series(Start=0, Step=1, Count=lng_5)

midpt = CurveMiddle(Curve=relaxation)
tag = TextTag3D(Location=midpt, Text=series_2, Size=Slider(0.3, range=0..1), Justification=7)
len = Length(Curve=relaxation)
panel_6 = Panel(len)

rod = Panel(mod)
loop_end_2 = LoopEnd(port=loop_start_2.port, Exit=toggle_2, Data=addition_2, TimeOutVal=0, pausedState=False, state="Constant output")
seed = Panel(round.Floor)
# Properties
button = Button()
loop_end_3 = LoopEnd(port=loop_start_3.port, Exit=toggle_3, Data=addition_3, TimeOutVal=0, pausedState=False, state="Constant output")
series_3 = Series(Start=0, Step=1, Count=lng_6)

midpt_2 = CurveMiddle(Curve=relaxation_2)
tag_2 = TextTag3D(Location=midpt_2, Text=series_3, Size=Slider(0.3, range=0..1), Justification=7)
len_2 = Length(Curve=relaxation_2)
panel_7 = Panel(len_2)

lng_7 = ListLength(List=relaxation)
lng_8 = ListLength(List=relaxation_3)
# Properties
button_2 = Button()
series_4 = Series(Start=0, Step=1, Count=lng_3)

panel_8 = Panel("""10
8
12
6
5
14
4
1
2
3
11
0
7
9
13
15""")
sort = SortList(Keys=panel_8, ValuesA=series_4)  # -> Keys, ValuesA
sort_2 = SortList(Keys=sort.ValuesA, ValuesA=relaxation_3)  # -> Keys, ValuesA
lng_9 = ListLength(List=series_4)
gradient = Gradient(
    LowerLimit="0",
    UpperLimit=lng_9,
    Parameter=series_4,
    stops=[0: RGB(234, 38, 0), 0.25: RGB(234, 126, 0), 0.5: RGB(254, 244, 84), 0.75: RGB(173, 203, 249), 1: RGB(75, 107, 169)])
preview = CustomPreview(Geometry=sort_2.ValuesA, Material=gradient)
panel_9 = Panel(gradient)

panel_10 = Panel(loop_end_2)
division_2 = Division(A=panel_10, B=lng_3)
mod_2 = Modulus(A=panel_10, B=lng_3)
round_2 = Round(Number=division_2)  # -> Nearest, Floor, Ceiling
lng_10 = ListLength(List=relaxation_2)
series_5 = Series(Start=0, Step=1, Count=lng_4)
panel_11 = Panel(loop_end_3)
division_3 = Division(A=panel_11, B=lng_4)
mod_3 = Modulus(A=panel_11, B=lng_4)
round_3 = Round(Number=division_3)  # -> Nearest, Floor, Ceiling
series_6 = Series(Start=0, Step=1, Count=lng_8)

number_slider = Slider(0.2, range=0..1)
midpt_3 = CurveMiddle(Curve=relaxation_3)
tag_3 = TextTag3D(Location=midpt_3, Text=series_6, Size=Slider(0.15, range=0..1), Justification=7)
len_3 = Length(Curve=relaxation_3)
panel_12 = Panel(len_3)

rod_2 = Panel(mod_2)
loop_start_4 = LoopStart(Repeat=lng_7, Trigger=button, Data="-1")  # -> port, Counter, Data
rod_3 = Panel(mod_3)
graft = GraftTree(Tree=[rod, seed], IncludeEmptyLists=True, IncludeNullItems=True)
seed_2 = Panel(round_2.Floor)
jitter = Jitter(List=series, Jitter=1, Seed=seed)  # -> Values, Indices
# Properties
button_3 = Button()
seed_3 = Panel(round_3.Floor)

panel_13 = Panel("""6
2
0
1
4
3
7
5
7
5
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""")
lng_11 = ListLength(List=panel_13)  # -> expr("x-2", Length)
panel_14 = Panel("1")
division_4 = Division(A=lng_11, B=lng)
series_7 = Series(Start=expr("x-1", lng), Step=lng, Count=division_4)
series_8 = Series(Start=0, Step=lng, Count=division_4)
dom = ConstructDomain(DomainStart=series_8, DomainEnd=series_7)
item = ListItem(List=dom, Index=seed_3, Wrap=True)
subset = SubList(List=panel_13, Domain=item, Wrap=True)  # -> List, Index
panel_15 = Panel(subset.List)

loop_start_5 = LoopStart(Repeat=lng_10, Trigger=button_2, Data="-1")  # -> port, Counter, Data
lng_12 = ListLength(List=relaxation_3)
rec = DataRecorder(graft, DataLimit=-10, RecordData=True)
series_9 = Series(Start=0, Step=1, Count=lng_2)
sort_3 = SortList(Keys=panel_3, ValuesA=series_9)  # -> Keys, ValuesA
sort_4 = SortList(Keys=sort_3.ValuesA, ValuesA=relaxation_2)  # -> Keys, ValuesA
lng_13 = ListLength(List=series_9)
gradient_2 = Gradient(
    LowerLimit="0",
    UpperLimit=lng_13,
    Parameter=series_9,
    stops=[0: RGB(234, 38, 0), 0.25: RGB(234, 126, 0), 0.5: RGB(254, 244, 84), 0.75: RGB(173, 203, 249), 1: RGB(75, 107, 169)])
preview_2 = CustomPreview(Geometry=sort_4.ValuesA, Material=gradient_2)
panel_16 = Panel(gradient_2)
panel_17 = Panel(jitter.Values)
addition_4 = Addition(A=loop_start_4.Data, B="1")
loop_start_6 = LoopStart(Repeat=lng_12, Trigger=button_3, Data="-1")  # -> port, Counter, Data
graft_2 = GraftTree(Tree=[rod_2, seed_2], IncludeEmptyLists=True, IncludeNullItems=True)
sort_5 = SortList(Keys=panel_17, ValuesA=series)  # -> Keys, ValuesA
bang = ExplodeTree(Data=rec)  # -> _0000, Branch1
graft_3 = GraftTree(Tree=[rod_3, seed_3], IncludeEmptyLists=True, IncludeNullItems=True)
jitter_2 = Jitter(List=series_4, Jitter=1, Seed=seed_2)  # -> Values, Indices
addition_5 = Addition(A=loop_start_5.Data, B="1")
loop_end_4 = LoopEnd(port=loop_start_4.port, Exit=button, Data=addition_4, TimeOutVal=0, pausedState=False, state="Constant output")
addition_6 = Addition(A=rod, B="1")
sort_6 = SortList(Keys=sort_5.ValuesA, ValuesA=relaxation)  # -> Keys, ValuesA
rec_2 = DataRecorder(graft_2, DataLimit=-10, RecordData=True)
panel_18 = Panel(subset.List)
panel_19 = Panel(jitter_2.Values)
rec_3 = DataRecorder(graft_3, DataLimit=-10, RecordData=True)
addition_7 = Addition(A=loop_start_6.Data, B="1")
loop_end_5 = LoopEnd(port=loop_start_5.port, Exit=button_2, Data=addition_5, TimeOutVal=0, pausedState=False, state="Constant output")
panel_20 = Panel(bang._0000)
sort_7 = SortList(Keys=panel_19, ValuesA=series_4)  # -> Keys, ValuesA
bang_2 = ExplodeTree(Data=rec_2)  # -> _0000, Branch1
panel_21 = Panel(loop_end_4)

crv = Curve(relaxation)
cluster = Cluster_2(relay=crv, i=panel_21)  # -> data_3, crv_6, data_4; disabled
panel_22 = Panel(cluster.data_3)
preview_3 = CustomPreview(Geometry=flatten(cluster.crv_6), Shader=flatten(cluster.data_4))

sort_8 = SortList(Keys=panel_18, ValuesA=series_5)  # -> Keys, ValuesA
bang_3 = ExplodeTree(Data=rec_3)  # -> _0000, Branch1
split = SplitList(List=sort_6.ValuesA, Index=addition_6)  # -> ListA, ListB
split_2 = SplitList(List=jitter.Values, Index=addition_6)  # -> ListA, ListB

crv_2 = Curve(relaxation)
crv_3 = Curve(relaxation)
item_2 = ListItem(List=crv_2, Index=Slider(7, range=0..10), Wrap=True)
ccx = CurveCurve(CurveA=item_2, CurveB=graft(crv_3))  # -> Points, ParamsA, ParamsB
duppt = RemoveDuplicatePts(Points=flatten(ccx.Points), Tolerance=0.01)
pt_2 = Point(ccx.Points)
lng_14 = ListLength(List=duppt)
panel_23 = Panel(lng_14)

loop_end_6 = LoopEnd(port=loop_start_6.port, Exit=button_3, Data=addition_7, TimeOutVal=0, pausedState=False, state="Constant output")

crv_4 = Curve(relaxation_2)
cluster_2 = Cluster(relay=crv_4, i=loop_end_5)  # -> data_3, crv_6, data_4; disabled
panel_24 = Panel(cluster_2.data_3)
preview_4 = CustomPreview(Geometry=flatten(cluster_2.crv_6), Shader=flatten(cluster_2.data_4))

addition_8 = Addition(A=rod_2, B="1")
sort_9 = SortList(Keys=sort_7.ValuesA, ValuesA=relaxation_3)  # -> Keys, ValuesA
panel_25 = Panel(loop_end_5)
panel_26 = Panel(bang.Branch1)
addition_9 = Addition(A=rod_3, B="1")
sort_10 = SortList(Keys=sort_8.ValuesA, ValuesA=relaxation)  # -> Keys, ValuesA
rod_undergo_sim = Panel(split_2.ListA)
polyline_undergo_sim = Panel(split.ListA)
panel_27 = Panel(bang_2._0000)

# ----
# Intersect pts
crv_5 = Curve(crv_4)
item_3 = ListItem(List=crv_5, Index=panel_25, Wrap=True)
ccx_2 = CurveCurve(CurveA=item_3, CurveB=graft(crv_5))  # -> Points, ParamsA, ParamsB
duppt_2 = RemoveDuplicatePts(Points=flatten(ccx_2.Points), Tolerance=0.01)
pt_3 = Point(ccx_2.Points)
len_4 = Length(Curve=item_3)
lng_15 = ListLength(List=duppt_2)
graft_4 = GraftTree(Tree=[len_4, lng_15], IncludeEmptyLists=True, IncludeNullItems=True)
rec_4 = DataRecorder(graft_4, DataLimit=-10, RecordData=True)
bang_4 = ExplodeTree(Data=rec_4)  # -> Branch0, _0000
panel_28 = Panel(bang_4.Branch0)
panel_29 = Panel(bang_4._0000)

cluster_3 = Cluster_2(relay=crv_4, i=loop_end_5)  # -> data_3, crv_6, data_4; disabled

crv_6 = Curve(relaxation_3)
cluster_4 = Cluster_2(relay=crv_6, i=loop_end_6)  # -> data_3, crv_6, data_4; disabled
panel_30 = Panel(cluster_4.data_3)
preview_5 = CustomPreview(Geometry=flatten(cluster_4.crv_6), Shader=flatten(cluster_4.data_4))

panel_31 = Panel(bang_3._0000)
panel_32 = Panel(loop_end_6)
lng_16 = ListLength(List=rod_undergo_sim)
split_3 = SplitList(List=sort_9.ValuesA, Index=addition_8)  # -> ListA, ListB
split_4 = SplitList(List=jitter_2.Values, Index=addition_8)  # -> ListA, ListB
split_5 = SplitList(List=sort_10.ValuesA, Index=addition_9)  # -> ListA, ListB
split_6 = SplitList(List=panel_18, Index=addition_9)  # -> ListA, ListB

# ----
# Intersect pts
crv_7 = Curve(crv_6)
item_4 = ListItem(List=crv_7, Index=panel_32, Wrap=True)
ccx_3 = CurveCurve(CurveA=item_4, CurveB=graft(crv_7))  # -> Points, ParamsA, ParamsB
duppt_3 = RemoveDuplicatePts(Points=flatten(ccx_3.Points), Tolerance=0.01)
pt_4 = Point(ccx_3.Points)
len_5 = Length(Curve=item_4)
lng_17 = ListLength(List=duppt_3)
graft_5 = GraftTree(Tree=[len_5, lng_17], IncludeEmptyLists=True, IncludeNullItems=True)
rec_5 = DataRecorder(graft_5, DataLimit=-10, RecordData=True)
bang_5 = ExplodeTree(Data=rec_5)  # -> Branch0, _0000
panel_33 = Panel(bang_5.Branch0)
panel_34 = Panel(bang_5._0000)

panel_35 = Panel(bang_2.Branch1)
item_5 = ListItem(List=rod_undergo_sim, Index=expr("x-1", lng_16), Wrap=True)

rec_6 = DataRecorder(polyline_undergo_sim, DataLimit=-10, RecordData=True)
rec_7 = DataRecorder(item_5, DataLimit=-10, RecordData=True)

panel_36 = Panel(cluster_3.data_3)
rod_undergo_sim_2 = Panel(split_4.ListA)
polyline_undergo_sim_2 = Panel(split_3.ListA)
lng_18 = ListLength(List=panel_6)  # -> expr("x-1", Length)
entwine = Entwine(Branch00=panel_21, Branch01=panel_22, FlattenInputs=True)
polyline_undergo_sim_3 = Panel(split_5.ListA)
rod_undergo_sim_3 = Panel(split_6.ListA)
rec_8 = DataRecorder(entwine, DataLimit=-10, RecordData=True)
lng_19 = ListLength(List=rod_undergo_sim_2)
polyline_undergo_sim_4 = Panel(rec_6)
polyline_undergo_sim_5 = Panel(item_5)
lng_20 = ListLength(List=rod_undergo_sim_3)
entwine_2 = Entwine(Branch00=panel_25, Branch01=panel_36, FlattenInputs=True)
dom_2 = ConstructDomain(DomainStart=0, DomainEnd=lng_18)
rec_9 = DataRecorder(entwine_2, DataLimit=-10, RecordData=True)
panel_37 = Panel(rec_8)
item_6 = ListItem(List=rod_undergo_sim_2, Index=expr("x-1", lng_19), Wrap=True)

rec_10 = DataRecorder(polyline_undergo_sim_2, DataLimit=-10, RecordData=True)
rec_11 = DataRecorder(item_6, DataLimit=-10, RecordData=True)

polyline_undergo_sim_6 = Panel(rec_10)
item_7 = ListItem(List=rod_undergo_sim_3, Index=expr("x-1", lng_20), Wrap=True)

rec_12 = DataRecorder(polyline_undergo_sim_3, DataLimit=-10, RecordData=True)
rec_13 = DataRecorder(item_7, DataLimit=-10, RecordData=True)

lng_21 = ListLength(List=panel_12)  # -> expr("x-1", Length)
entwine_3 = Entwine(Branch00=panel_32, Branch01=panel_30, FlattenInputs=True)
polyline_undergo_sim_7 = Panel(rec_7)
panel_38 = Panel(rec_9)
rec_14 = DataRecorder(entwine_3, DataLimit=-10, RecordData=True)
sim_w_o_floor = SimWFloor(crv=split.ListA)  # -> data_3, crv_8, data_4; disabled
polyline_undergo_sim_8 = Panel(item_6)
toggle_4 = BooleanToggle(False)

multiplication_4 = Multiplication(A=Slider(100, range=0..100), B=lng_2)
loop_start_7 = LoopStart(Repeat=multiplication_4, Trigger=toggle_4, Data="-1")  # -> port, Counter, Data
addition_10 = Addition(A=loop_start_7.Data, B="1")
division_5 = Division(A=addition_10, B=lng_2)
mod_4 = Modulus(A=addition_10, B=lng_2)
round_4 = Round(Number=division_5)  # -> Nearest, Floor, Ceiling
rod_4 = Panel(mod_4)
loop_end_7 = LoopEnd(port=loop_start_7.port, Exit=toggle_4, Data=addition_10, TimeOutVal=0, pausedState=False, state="Constant output")
seed_4 = Panel(round_4.Floor)
panel_39 = Panel(loop_end_7)

graft_6 = GraftTree(Tree=[rod_4, seed_4], IncludeEmptyLists=True, IncludeNullItems=True)
rec_15 = DataRecorder(graft_6, DataLimit=-10, RecordData=True)
jitter_3 = Jitter(List=relaxation_2, Jitter=1, Seed=seed_4)  # -> Values, Indices
jitter_4 = Jitter(List=series_9, Jitter=1, Seed=seed_4)  # -> Values, Indices
bang_6 = ExplodeTree(Data=rec_15)  # -> _0000, Branch1
panel_40 = Panel(jitter_4.Values)
panel_41 = Panel(bang_6._0000)
split_7 = SplitList(List=jitter_3.Values, Index=expr("x+1", rod_4))  # -> ListA, ListB
split_8 = SplitList(List=jitter_4.Values, Index=expr("x+1", rod_4))  # -> ListA, ListB
panel_42 = Panel(bang_6.Branch1)
dcon = DeleteConsecutive(Set=panel_42, Wrap=False)  # -> Set, Count
lng_22 = ListLength(List=dcon.Set)  # -> expr("x-1", Length)
split_9 = SplitList(List=dcon.Set, Index=lng_22)  # -> ListA, ListB
jitter_5 = Jitter(List=series_9, Jitter=1, Seed=split_9.ListA)  # -> Values, Indices
panel_43 = Panel(jitter_5.Values)
flatten = FlattenTree(Tree=panel_43, Path="{0}")
polyline_undergo_sim_9 = Panel(split_7.ListA)
rod_undergo_sim_4 = Panel(split_8.ListA)

rec_16 = DataRecorder(polyline_undergo_sim_9, DataLimit=-10, RecordData=True)
rec_17 = DataRecorder(rod_undergo_sim_4, DataLimit=-10, RecordData=True)

polyline_undergo_sim_10 = Panel(rec_16)
polyline_undergo_sim_11 = Panel(rec_17)
dcon_2 = DeleteConsecutive(Set=panel_37, Wrap=False)  # -> Set, Count
polyline_undergo_sim_12 = Panel(item_7)
panel_44 = Panel(rec_12)
dom_3 = ConstructDomain(DomainStart=0, DomainEnd=lng_21)
sim_w_o_floor_2 = SimWFloor(crv=split_7.ListA)  # -> data_3, crv_8, data_4; disabled
bang_7 = ExplodeTree()  # -> Branch0, Branch1, Branch2
panel_45 = Panel(rec_14)
dcon_3 = DeleteConsecutive(Set=panel_38, Wrap=False)  # -> Set, Count
bang_8 = ExplodeTree(Data=dcon_2.Set)  # -> Branch0, Branch1
panel_46 = Panel(sim_w_o_floor.data_3)
preview_6 = CustomPreview(Geometry=flatten(sim_w_o_floor.crv_8), Shader=flatten(sim_w_o_floor.data_4))
polyline_undergo_sim_13 = Panel(rec_11)
sim_w_o_floor_3 = SimWFloor(crv=split_3.ListA)  # -> data_3, crv_8, data_4; disabled
sim_w_floor = SimWFloor(crv=split_3.ListA)  # -> data_3, crv_8, data_4; disabled
polyline_undergo_sim_14 = Panel(rec_13)
bang_9 = ExplodeTree(Data=dcon_3.Set)  # -> Branch0, Branch1
panel_47 = Panel(sim_w_o_floor_2.data_3)
preview_7 = CustomPreview(Geometry=flatten(sim_w_o_floor_2.crv_8), Shader=flatten(sim_w_o_floor_2.data_4))
dcon_4 = DeleteConsecutive(Set=panel_45, Wrap=False)  # -> Set, Count
panel_48 = Panel([bang_7.Branch0, bang_7.Branch1, bang_7.Branch2])
sim_w_o_floor_4 = SimWFloor(crv=split_5.ListA)  # -> data_3, crv_8, data_4; disabled
panel_49 = Panel(bang_8.Branch0)

rec_18 = DataRecorder(panel_46, DataLimit=-10, RecordData=True)
# Result
panel_50 = Panel(rec_18)

bang_10 = ExplodeTree()  # -> Branch0, Branch1, Branch2
clean = CleanTree(RemoveNulls=True, RemoveInvalid=True, RemoveEmpty=False, Tree=polyline_undergo_sim_7)
bang_11 = ExplodeTree(Data=dcon_4.Set)  # -> Branch0, Branch1

# ----
# Result
rec_19 = DataRecorder(panel_47, DataLimit=-10, RecordData=True)
panel_51 = Panel(rec_19)

panel_52 = Panel(sim_w_o_floor_3.data_3)
preview_8 = CustomPreview(Geometry=flatten(sim_w_o_floor_3.crv_8), Shader=flatten(sim_w_o_floor_3.data_4))
panel_53 = Panel(bang_9.Branch0)
panel_54 = Panel(sim_w_o_floor_4.data_3)
preview_9 = CustomPreview(Geometry=flatten(sim_w_o_floor_4.crv_8), Shader=flatten(sim_w_o_floor_4.data_4))
panel_55 = Panel("D:\ahYen's Workspace\ahYen's Work\Study THU\Y5 2023-24\Final Year Project\工序研究\Data_disp_rod\0415_data.xlsx")
panel_56 = Panel(bang_8.Branch1)
entwine_4 = Entwine(Branch00=panel_49, Branch01=panel_56, Branch02=panel_6, FlattenInputs=True)
subset_2 = SubList(List=entwine_4, Domain=dom_2, Wrap=True)  # -> List, Index
panel_57 = Panel(subset_2.List)
panel_58 = Panel([bang_10.Branch0, bang_10.Branch1, bang_10.Branch2])
panel_59 = Panel(bang_9.Branch1)

lng_23 = ListLength(List=panel_7)  # -> expr("x-1", Length)
entwine_5 = Entwine(Branch00=panel_53, Branch01=panel_59, Branch02=panel_7, FlattenInputs=True)
dom_4 = ConstructDomain(DomainStart=0, DomainEnd=lng_23)
subset_3 = SubList(List=entwine_5, Domain=dom_4, Wrap=True)  # -> List, Index
panel_60 = Panel(subset_3.List)
bang_12 = ExplodeTree()  # -> Branch0, Branch1, Branch2
panel_61 = Panel([bang_12.Branch0, bang_12.Branch1, bang_12.Branch2])
panel_62 = Panel("D:\ahYen's Workspace\ahYen's Work\Study THU\Y5 2023-24\Final Year Project\工序研究\Data_disp_rod\0415_data.xlsx")
F = FillCell(Start=Button(), FilePath=panel_62, SheetName="S3_properties", Cells=flatten(panel_61), Data=flatten(panel_60))

polyline_undergo_sim_15 = Panel(clean)
panel_63 = Panel(bang_11.Branch0)

rec_20 = DataRecorder(panel_52, DataLimit=-10, RecordData=True)
# Result
panel_64 = Panel(rec_20)

rec_21 = DataRecorder(panel_54, DataLimit=-10, RecordData=True)
panel_65 = Panel(rec_21)

clean_2 = CleanTree(RemoveNulls=True, RemoveInvalid=True, RemoveEmpty=False, Tree=polyline_undergo_sim_13)
clean_3 = CleanTree(RemoveNulls=True, RemoveInvalid=True, RemoveEmpty=False, Tree=polyline_undergo_sim_14)
data = Data(["2.00291", "2.00291", "1.301794", "1.9638", "1.956483", "1.055173"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])
clean_4 = CleanTree(RemoveNulls=True, RemoveInvalid=True, RemoveEmpty=False, Tree=panel_50)
panel_66 = Panel("D:\ahYen's Workspace\ahYen's Work\Study THU\Y5 2023-24\Final Year Project\工序研究\Data_disp_rod\0415_data.xlsx")
panel_67 = Panel(bang_11.Branch1)
entwine_6 = Entwine(Branch00=panel_63, Branch01=panel_67, Branch02=panel_12, FlattenInputs=True)
subset_4 = SubList(List=entwine_6, Domain=dom_3, Wrap=True)  # -> List, Index
panel_68 = Panel(subset_4.List)

acesding_0_15 = Data([0.03818279077, 0.08604334174, 0.1039327267, 0.103679208, 0.1463547624, 0.8097947464, 0.4458937865, 0.4458919986, 0.2904520084, 0.2821369943, 0.1269882314, 0.115737303, 0.005106031796, 0.009761954777, 0.01437401585, 0.01253988893])
panel_69 = Panel(acesding_0_15)

lng_24 = ListLength(List=polyline_undergo_sim_15)
polyline_undergo_sim_16 = Panel(clean_2)
polyline_undergo_sim_17 = Panel(clean_3)
dom_5 = ConstructDomain(DomainStart="0", DomainEnd=expr("X-2", Slider(9, range=0..10)))
F_2 = FillCell(Start=Button(), FilePath=panel_55, SheetName="S2_properties", Cells=flatten(panel_48), Data=flatten(panel_57))
dom_6 = ConstructDomain(DomainStart="0", DomainEnd=expr("X-2", lng_24))
clean_5 = CleanTree(RemoveNulls=True, RemoveInvalid=True, RemoveEmpty=False, Tree=panel_64)
subset_5 = SubList(List=polyline_undergo_sim_15, Domain=dom_5, Wrap=True)  # -> List, Index
lng_25 = ListLength(List=panel_27)
panel_70 = Panel(clean_4)
subset_6 = SubList(List=polyline_undergo_sim_15, Domain=dom_6, Wrap=True)  # -> List, Index
clean_6 = CleanTree(RemoveNulls=True, RemoveInvalid=True, RemoveEmpty=False, Tree=panel_65)
lng_26 = ListLength(List=polyline_undergo_sim_17)
dom_7 = ConstructDomain(DomainStart="1", DomainEnd=expr("x-2", lng_25))
F_3 = FillCell(Start=Button(), FilePath=panel_66, SheetName="S2_properties", Cells=flatten(panel_58), Data=flatten(panel_68))
panel_71 = Panel(clean_5)
dom_8 = ConstructDomain(DomainStart="1", DomainEnd=expr("X-2", lng_26))

lng_27 = ListLength(List=panel_20)  # -> expr("x-2", Length)
division_6 = Division(A=lng_27, B=lng)
series_10 = Series(Start=expr("x-1", lng), Step=lng, Count=division_6)
series_11 = Series(Start=0, Step=lng, Count=division_6)
dom_9 = ConstructDomain(DomainStart=series_11, DomainEnd=series_10)

lng_28 = ListLength(List=panel_41)
panel_73 = Panel(clean_6)

lng_29 = ListLength(List=panel_41)  # -> expr("x-2", Length)
division_7 = Division(A=lng_29, B=lng_2)
series_12 = Series(Start=expr("x-1", lng_2), Step=lng_2, Count=division_7)
series_13 = Series(Start=0, Step=lng_2, Count=division_7)
dom_10 = ConstructDomain(DomainStart=series_13, DomainEnd=series_12)

subset_7 = SubList(List=polyline_undergo_sim_17, Domain=dom_8, Wrap=True)  # -> List, Index
subset_8 = SubList(List=panel_27, Domain=dom_7, Wrap=True)  # -> List, Index
dom_11 = ConstructDomain(DomainStart="1", DomainEnd=expr("x-2", lng_28))

lng_30 = ListLength(List=panel_27)  # -> expr("x-2", Length)
division_8 = Division(A=lng_30, B=lng_3)
series_14 = Series(Start=expr("x-1", lng_3), Step=lng_3, Count=division_8)
series_15 = Series(Start=0, Step=lng_3, Count=division_8)
dom_12 = ConstructDomain(DomainStart=series_15, DomainEnd=series_14)

subset_9 = SubList(List=subset_8.List, Domain=dom_12, Wrap=True)  # -> List, Index

lng_31 = ListLength(List=panel_31)  # -> expr("x-2", Length)
division_9 = Division(A=lng_31, B=lng_4)
series_16 = Series(Start=expr("x-1", lng_4), Step=lng_4, Count=division_9)
series_17 = Series(Start=0, Step=lng_4, Count=division_9)
dom_13 = ConstructDomain(DomainStart=series_17, DomainEnd=series_16)

subset_10 = SubList(List=panel_51, Domain=dom_11, Wrap=True)  # -> List, Index
subset_11 = SubList(List=panel_41, Domain=dom_11, Wrap=True)  # -> List, Index
subset_12 = SubList(List=subset_6.List, Domain=dom_9, Wrap=True)  # -> List, Index
subset_13 = SubList(List=panel_70, Domain=dom_9, Wrap=True)  # -> List, Index
subset_14 = SubList(List=subset_10.List, Domain=dom_10, Wrap=True)  # -> List, Index
subset_15 = SubList(List=subset_11.List, Domain=dom_10, Wrap=True)  # -> List, Index
subset_16 = SubList(List=flatten, Domain=dom_10, Wrap=True)  # -> List, Index

panel_77 = Panel(subset_13.List)
panel_78 = Panel(subset_12.List)

panel_79 = Panel(subset_15.List)
panel_80 = Panel(subset_14.List)
panel_81 = Panel(subset_16.List)

subset_17 = SubList(List=clean_5, Domain=dom_12, Wrap=True)  # -> List, Index
subset_18 = SubList(List=polyline_undergo_sim_16, Domain=dom_12, Wrap=True)  # -> List, Index
subset_19 = SubList(List=subset_7.List, Domain=dom_13, Wrap=True)  # -> List, Index
subset_20 = SubList(List=panel_73, Domain=dom_13, Wrap=True)  # -> List, Index

panel_82 = Panel(subset_9.List)
panel_83 = Panel(subset_17.List)
panel_84 = Panel(subset_18.List)

panel_85 = Panel(subset_20.List)
panel_86 = Panel(subset_19.List)

disp_list = Data(simplify(Tree({0}: ["6.983414", "6.993276", "6.877519", "4.987506", "0.179629", "0.169428", "0.126582", "0.051831"], {1}: ["5.153109", "3.276596", "0.462972", "0.252491", "0.122861", "0.071367", "0.050476", "0.050192"], {2}: ["6.983414", "1.526662", "1.486372", "1.487412", "0.967441", "0.084709", "0.074504", "0.051074"], {3}: ["6.093292", "5.174195", "0.886499", "0.236121", "0.137007", "0.088816", "0.050821", "0.050822"], {4}: ["6.983414", "6.750252", "6.756106", "4.98283", "1.152142", "0.120671", "0.091799", "0.051603"], {5}: ["6.343037", "0.979781", "0.601457", "0.451233", "0.354682", "0.12958", "0.127841", "0.050001"]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)))
rod_list = Data(simplify(Tree({0}: ["4", "7", "5", "3", "0", "2", "1", "6"], {1}: ["1", "0", "6", "5", "2", "4", "3", "7"], {2}: ["4", "2", "5", "7", "1", "6", "0", "3"], {3}: ["5", "3", "6", "0", "4", "1", "2", "7"], {4}: ["4", "5", "7", "3", "2", "6", "0", "1"], {5}: ["6", "2", "0", "1", "4", "3", "7", "5"]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)))

rod_list_2 = Data(simplify(Tree({0;0;0;0;0}: ["1", "0", "6", "5", "2", "4", "3"], {0;0;0;0;1}: ["1", "0", "6", "5", "2", "4", "3"], {0;0;0;0;2}: ["4", "2", "5", "1", "0", "6", "3"], {0;0;0;0;3}: ["6", "5", "3", "0", "4", "1", "2"], {0;0;0;0;4}: ["4", "5", "3", "2", "6", "0", "1"], {0;0;0;0;5}: ["4", "5", "3", "2", "6", "0", "1"]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)))
disp_list_2 = Data(simplify(Tree({0;0;0;0}: ["3.803561", "3.803768", "3.809143", "0.231969", "0.130574", "0.086188", "0.026359"], {0;0;0;1}: ["3.803561", "3.803768", "3.809143", "0.231969", "0.130574", "0.086188", "0.026359"], {0;0;0;2}: ["3.949211", "2.717873", "0.658612", "0.130623", "0.091107", "0.090824", "0.027732"], {0;0;0;3}: ["0.038978", "0.83508", "0.572575", "0.17543", "0.105206", "0.080462", "0.026199"], {0;0;0;4}: ["3.949211", "0.995611", "0.467049", "0.0775", "0.077421", "0.051342", "0.027338"], {0;0;0;5}: ["3.949211", "0.995611", "0.467049", "0.0775", "0.077421", "0.051342", "0.027338"]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)))

rod_list_3 = Data(simplify(panel_84))
disp_list_3 = Data(simplify(panel_83))

rod_list_4 = Data(simplify(Tree({0}: ["15", "4", "9", "10", "7", "13", "11", "5", "3", "12", "0", "2", "1", "6", "8", "14"], {1}: ["10", "8", "1", "11", "0", "6", "12", "5", "2", "14", "4", "15", "9", "3", "7", "13"], {2}: ["12", "11", "9", "4", "2", "8", "15", "5", "14", "1", "7", "13", "0", "10", "6", "3"], {3}: ["13", "14", "5", "3", "0", "6", "8", "9", "10", "4", "12", "1", "11", "2", "15", "7"], {4}: ["4", "5", "10", "3", "12", "8", "7", "13", "15", "11", "2", "9", "6", "14", "0", "1"], {5}: ["9", "12", "13", "6", "15", "2", "1", "11", "0", "4", "14", "8", "3", "5", "7", "10"]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)))
disp_list_4 = Data(simplify(Tree({0}: ["2.00291", "1.301794", "1.9638", "1.956483", "1.055173", "1.260134", "0.544508", "0.12234", "0.116386", "0.058862", "0.058916", "0.058185", "0.059648", "0.02408", "0.012707", "0.023119"], {1}: ["2.79237", "1.481233", "0.488051", "0.377958", "0.37794", "0.384624", "0.153588", "0.152072", "0.079424", "0.138788", "0.039749", "0.03968", "0.038656", "0.031123", "0.018359", "0.01844"], {2}: ["2.834895", "1.030464", "2.162986", "0.970858", "0.976859", "0.983909", "0.9839", "0.111963", "0.112848", "0.124509", "0.057754", "0.057741", "0.058584", "0.056471", "0.038167", "0.020657"], {3}: ["1.208471", "2.084037", "1.284003", "0.858916", "0.808453", "0.444877", "0.292499", "0.283075", "0.737642", "0.172888", "0.108549", "0.02406", "0.059284", "0.026254", "0.026309", "0.024059"], {4}: ["0.146539", "0.810379", "0.508565", "0.176484", "0.203827", "0.133854", "0.233511", "0.23277", "0.232768", "0.096167", "0.052783", "0.055228", "0.029161", "0.029228", "0.029643", "0.021574"], {5}: ["2.299968", "2.946044", "2.955762", "1.14567", "1.301903", "1.082127", "0.422691", "0.089769", "0.090394", "0.06137", "0.061449", "0.038915", "0.040193", "0.029061", "0.021985", "0.021959"]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)))

bang_13 = ExplodeTree(Data=disp_list)  # -> Branch0, Branch1

rod_list_5 = Data(simplify(rod_list_3))
disp_list_5 = Data(simplify(disp_list_3))

rod_list_6 = Data(simplify(Tree({0;0;0;0;0}: ["1", "0", "6", "5", "2", "4", "3"], {0;0;0;0;1}: ["1", "0", "6", "5", "2", "4", "3"], {0;0;0;0;2}: ["4", "2", "5", "1", "0", "6", "3"], {0;0;0;0;3}: ["6", "5", "3", "0", "4", "1", "2"], {0;0;0;0;4}: ["4", "5", "3", "2", "6", "0", "1"], {0;0;0;0;5}: ["4", "5", "3", "2", "6", "0", "1"]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)))
disp_list_6 = Data(simplify(Tree({0;0;0;0}: ["3.803561", "3.803768", "3.809143", "0.231969", "0.130574", "0.086188", "0.026359"], {0;0;0;1}: ["3.803561", "3.803768", "3.809143", "0.231969", "0.130574", "0.086188", "0.026359"], {0;0;0;2}: ["3.949211", "2.717873", "0.658612", "0.130623", "0.091107", "0.090824", "0.027732"], {0;0;0;3}: ["0.038978", "0.83508", "0.572575", "0.17543", "0.105206", "0.080462", "0.026199"], {0;0;0;4}: ["3.949211", "0.995611", "0.467049", "0.0775", "0.077421", "0.051342", "0.027338"], {0;0;0;5}: ["3.949211", "0.995611", "0.467049", "0.0775", "0.077421", "0.051342", "0.027338"]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)))

lng_32 = ListLength(List=bang_13.Branch0)
number_slider_2 = Slider(100, range=0..100)

rod_list_7 = Data(simplify(rod_list_4))
disp_list_7 = Data(simplify(disp_list_4))

rod_list_8 = Data(simplify(Tree({0;0;0;0;0}: ["1", "0", "6", "5", "2", "4", "3"], {0;0;0;0;1}: ["1", "0", "6", "5", "2", "4", "3"], {0;0;0;0;2}: ["4", "2", "5", "1", "0", "6", "3"], {0;0;0;0;3}: ["6", "5", "3", "0", "4", "1", "2"], {0;0;0;0;4}: ["4", "5", "3", "2", "6", "0", "1"], {0;0;0;0;5}: ["4", "5", "3", "2", "6", "0", "1"]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)))
disp_list_8 = Data(simplify(Tree({0;0;0;0}: ["3.803561", "3.803768", "3.809143", "0.231969", "0.130574", "0.086188", "0.026359"], {0;0;0;1}: ["3.803561", "3.803768", "3.809143", "0.231969", "0.130574", "0.086188", "0.026359"], {0;0;0;2}: ["3.949211", "2.717873", "0.658612", "0.130623", "0.091107", "0.090824", "0.027732"], {0;0;0;3}: ["0.038978", "0.83508", "0.572575", "0.17543", "0.105206", "0.080462", "0.026199"], {0;0;0;4}: ["3.949211", "0.995611", "0.467049", "0.0775", "0.077421", "0.051342", "0.027338"], {0;0;0;5}: ["3.949211", "0.995611", "0.467049", "0.0775", "0.077421", "0.051342", "0.027338"]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)))

bang_14 = ExplodeTree(Data=disp_list_5)  # -> Branch0, Branch1
series_18 = Series(Start="1", Step=0, Count=number_slider_2)
series_19 = Series(Start="1", Step=1, Count=number_slider_2)  # -> simplify(Series)
lng_33 = ListLength(List=bang_14.Branch0)
bang_15 = ExplodeTree(Data=disp_list_7)  # -> Branch0, Branch1
series_20 = Series(Start=lng_32, Step=0, Count=number_slider_2)  # -> simplify(graft(Series))
dup = DuplicateData(Data=graft(series_19), Number=series_20, Order=True)  # -> simplify(Data)
number_slider_3 = Slider(100, range=0..100)
lng_34 = ListLength(List=bang_15.Branch0)
number_slider_4 = Slider(100, range=0..100)
panel_87 = Panel(series_20)
series_21 = Series(Start="1", Step=0, Count=number_slider_3)
series_22 = Series(Start="1", Step=1, Count=number_slider_3)  # -> simplify(Series)
series_23 = Series(Start=lng_33, Step=0, Count=number_slider_3)  # -> simplify(graft(Series))
series_24 = Series(Start="1", Step=0, Count=number_slider_4)
series_25 = Series(Start="1", Step=1, Count=number_slider_4)  # -> simplify(Series)
dup_2 = DuplicateData(Data=graft(series_22), Number=series_23, Order=True)  # -> simplify(Data)
series_26 = Series(Start=lng_34, Step=0, Count=number_slider_4)  # -> simplify(graft(Series))
dup_3 = DuplicateData(Data=graft(series_25), Number=series_26, Order=True)  # -> simplify(Data)
panel_88 = Panel(series_23)
panel_89 = Panel(series_26)

lng_35 = ListLength(List=relaxation)
series_27 = Series(Start=0, Step=1, Count=lng_35)
custom_seq = Data(panel)
panel_90 = Panel(series_27)
panel_91 = Panel(custom_seq)
button_4 = Button()
sort_11 = SortList(Keys=panel_91, ValuesA=panel_90)  # -> Keys, ValuesA
lng_36 = ListLength(List=relaxation)
sort_12 = SortList(Keys=sort_11.ValuesA, ValuesA=relaxation)  # -> Keys, ValuesA
loop_start_8 = LoopStart(Repeat=lng_36, Trigger=button_4, Data="-1")  # -> port, Counter, Data
addition_11 = Addition(A=loop_start_8.Data, B="1")
loop_end_8 = LoopEnd(port=loop_start_8.port, Exit=button_4, Data=addition_11, TimeOutVal=0, pausedState=False, state="Constant output")
panel_92 = Panel(loop_end_8)
split_10 = SplitList(List=sort_12.ValuesA, Index=panel_92)  # -> ListA, ListB
panel_93 = Panel(split_10.ListA)

sim_w_o_floor_5 = SimWFloor(crv=split_10.ListA)  # -> data_3, crv_8, data_4; disabled
cluster_5 = SimWFloor(crv=split_10.ListA)  # -> data_3, crv_8, data_4; disabled

preview_10 = CustomPreview(Geometry=flatten(sim_w_o_floor_5.crv_8), Shader=flatten(sim_w_o_floor_5.data_4))
panel_94 = Panel(sim_w_o_floor_5.data_3)
rec_22 = DataRecorder(panel_94, DataLimit=-10, RecordData=True)
clean_7 = CleanTree(RemoveNulls=True, RemoveInvalid=True, RemoveEmpty=False, Tree=rec_22)

panel_95 = Panel(clean_7)

# ----
# Validation
lng_37 = ListLength(List=relaxation_2)
series_28 = Series(Start=0, Step=1, Count=lng_37)
custom_seq_2 = Data(panel_2)
panel_96 = Panel(series_28)
panel_97 = Panel(custom_seq_2)
button_5 = Button()
sort_13 = SortList(Keys=panel_97, ValuesA=panel_96)  # -> Keys, ValuesA
lng_38 = ListLength(List=relaxation_2)
sort_14 = SortList(Keys=sort_13.ValuesA, ValuesA=relaxation_2)  # -> Keys, ValuesA
loop_start_9 = LoopStart(Repeat=lng_38, Trigger=button_5, Data="-1")  # -> port, Counter, Data
addition_12 = Addition(A=loop_start_9.Data, B="1")
loop_end_9 = LoopEnd(port=loop_start_9.port, Exit=button_5, Data=addition_12, TimeOutVal=0, pausedState=False, state="Constant output")
panel_98 = Panel(loop_end_9)
split_11 = SplitList(List=sort_14.ValuesA, Index=panel_98)  # -> ListA, ListB
panel_99 = Panel(split_11.ListA)

sim_w_o_floor_6 = SimWFloor(crv=split_11.ListA)  # -> data_3, crv_8, data_4

preview_11 = CustomPreview(Geometry=flatten(sim_w_o_floor_6.crv_8), Shader=flatten(sim_w_o_floor_6.data_4))
panel_100 = Panel(sim_w_o_floor_6.data_3)
rec_23 = DataRecorder(panel_100, DataLimit=-10, RecordData=True)
panel_101 = Panel(rec_23)
clean_8 = CleanTree(RemoveNulls=True, RemoveInvalid=True, RemoveEmpty=False, Tree=panel_101)

panel_102 = Panel(clean_8)

lng_39 = ListLength(List=relaxation_3)
series_29 = Series(Start=0, Step=1, Count=lng_39)
custom_seq_3 = Data(panel_4)
panel_103 = Panel(series_29)
panel_104 = Panel(custom_seq_3)
button_6 = Button()
sort_15 = SortList(Keys=panel_104, ValuesA=panel_103)  # -> Keys, ValuesA
lng_40 = ListLength(List=relaxation_3)
# Validation
sort_16 = SortList(Keys=sort_15.ValuesA, ValuesA=relaxation_3)  # -> Keys, ValuesA
loop_start_10 = LoopStart(Repeat=lng_40, Trigger=button_6, Data="-1")  # -> port, Counter, Data
addition_13 = Addition(A=loop_start_10.Data, B="1")
loop_end_10 = LoopEnd(port=loop_start_10.port, Exit=button_6, Data=addition_13, TimeOutVal=0, pausedState=False, state="Constant output")
panel_105 = Panel(loop_end_10)
split_12 = SplitList(List=sort_16.ValuesA, Index=panel_105)  # -> ListA, ListB
panel_106 = Panel(split_12.ListA)

sim_w_o_floor_7 = SimWFloor(crv=split_12.ListA)  # -> data_3, crv_8, data_4; disabled

preview_12 = CustomPreview(Geometry=flatten(sim_w_o_floor_7.crv_8), Shader=flatten(sim_w_o_floor_7.data_4))
panel_107 = Panel(sim_w_o_floor_7.data_3)
rec_24 = DataRecorder(panel_107, DataLimit=-10, RecordData=True)
panel_108 = Panel(rec_24)

clean_9 = CleanTree(RemoveNulls=True, RemoveInvalid=True, RemoveEmpty=False, Tree=panel_108)
panel_109 = Panel(clean_9)

panel_110 = Panel(rod_list)
lng_41 = ListLength(List=disp_list)
panel_111 = Panel(disp_list)
series_30 = Series(Start="1", Step=1, Count=lng_41)  # -> simplify(Series)
c_script = CSharpScript()  # -> out, A
# ---------- c_script: C# ----------
    Point3d startPoint = Point3d.Origin;
    double spacing = 10.0;

    if (x is Point3d)
      startPoint = (Point3d) x;

    if (y is double)
      spacing = (double) y;

    List<string> alphabet = new List<string>();
    List<Point3d> letterPoints = new List<Point3d>();

    int asciiA = (int) 'A';
    int asciiZ = (int) 'Z';

    for (int i = asciiA; i <= asciiZ; i++)
    {
      char letter = (char) i;
      alphabet.Add(letter.ToString());

      Point3d point = new Point3d(startPoint.X + i * spacing, startPoint.Y, startPoint.Z);
      letterPoints.Add(point);
    }

    A = alphabet;
# ---------- end c_script ----------
tstat = TreeStatistics(Tree=lng_41)  # -> Paths, Length, Count
panel_112 = Panel("D:\ahYen's Workspace\ahYen's Work\Study THU\Y5 2023-24\Final Year Project\工序研究\Data_disp_rod\0423_dataonly_3.xlsx")

split_13 = SplitList(List=c_script.A, Index=lng_32)  # -> flatten(ListA), ListB
panel_113 = Panel(split_13.ListA)
dup_4 = DuplicateData(Data=panel_113, Number=graft(series_18), Order=True)  # -> simplify(Data)

merge = Merge(Data1=graft(dup_4), Data2=graft(dup))
join = TextJoin(Text=merge)
path_mapper = PathMapper(join, source="（A;B)", target="（A)")
panel_114 = Panel(path_mapper)
F_4 = FillCell(Start=Button(), FilePath=panel_112, SheetName="S1_ori_disp_100", Cells=flatten(panel_114), Data=flatten(panel_111))
F_5 = FillCell(Start=Button(), FilePath=panel_112, SheetName="S1_ori_rod#_100", Cells=flatten(panel_114), Data=flatten(panel_110))

panel_115 = Panel(path_mapper)

panel_116 = Panel(rod_list_5)
lng_42 = ListLength(List=disp_list_5)
panel_117 = Panel(disp_list_5)
series_31 = Series(Start="1", Step=1, Count=lng_42)  # -> simplify(Series)
c_script_2 = CSharpScript()  # -> out, A; same code as c_script
tstat_2 = TreeStatistics(Tree=lng_42)  # -> Paths, Length, Count
panel_118 = Panel("D:\ahYen's Workspace\ahYen's Work\Study THU\Y5 2023-24\Final Year Project\工序研究\Data_disp_rod\0423_dataonly_3.xlsx")

split_14 = SplitList(List=c_script_2.A, Index=lng_33)  # -> flatten(ListA), ListB
panel_119 = Panel(split_14.ListA)
dup_5 = DuplicateData(Data=panel_119, Number=graft(series_21), Order=True)  # -> simplify(Data)

merge_2 = Merge(Data1=graft(dup_5), Data2=graft(dup_2))
join_2 = TextJoin(Text=merge_2)
path_mapper_2 = PathMapper(join_2, source="（A;B)", target="（A)")
panel_120 = Panel(path_mapper_2)
F_6 = FillCell(Start=Button(), FilePath=panel_118, SheetName="S2_ori_rod#_100", Cells=flatten(panel_120), Data=flatten(panel_116))
F_7 = FillCell(Start=Button(), FilePath=panel_118, SheetName="S2_ori_disp_100", Cells=flatten(panel_120), Data=flatten(panel_117))

panel_121 = Panel(path_mapper_2)

panel_122 = Panel(rod_list_7)
lng_43 = ListLength(List=disp_list_7)
panel_123 = Panel(disp_list_7)
series_32 = Series(Start="1", Step=1, Count=lng_43)  # -> simplify(Series)
c_script_3 = CSharpScript()  # -> out, A; same code as c_script
tstat_3 = TreeStatistics(Tree=lng_43)  # -> Paths, Length, Count
panel_124 = Panel("D:\ahYen's Workspace\ahYen's Work\Study THU\Y5 2023-24\Final Year Project\工序研究\Data_disp_rod\0423_dataonly_3.xlsx")

split_15 = SplitList(List=c_script_3.A, Index=lng_34)  # -> flatten(ListA), ListB
panel_125 = Panel(split_15.ListA)
dup_6 = DuplicateData(Data=panel_125, Number=graft(series_24), Order=True)  # -> simplify(Data)

merge_3 = Merge(Data1=graft(dup_6), Data2=graft(dup_3))
join_3 = TextJoin(Text=merge_3)
path_mapper_3 = PathMapper(join_3, source="（A;B)", target="（A)")
panel_126 = Panel(path_mapper_3)
F_8 = FillCell(Start=Button(), FilePath=panel_124, SheetName="S3_ori_rod#_100", Cells=flatten(panel_126), Data=flatten(panel_122))
F_9 = FillCell(Start=Button(), FilePath=panel_124, SheetName="S3_ori_disp_100", Cells=flatten(panel_126), Data=flatten(panel_123))

panel_127 = Panel(path_mapper_3)

# ==== cluster Cluster
relay = ClusterInput()
i = ClusterInput()
item = ListItem(List=relay, Index=i, Wrap=True)

# ---- group: Rod
crv = Curve(flatten(item))

# ---- group: FRP截面尺寸
t = Slider(0.005, range=0..0.1)
D = Slider(0.05, range=0..0.1)
division = Division(A=D, B="2")
t_2 = Number(t)

# ----
crv_2 = Curve(crv)

gfrp = Panel("2.5E10")
material_elasticity = Panel(gfrp)

# ---- group: RODs Geometry
len = Length(Curve=crv_2)
explode = Explode(Curve=crv_2, Recursive=True)  # -> flatten(Segments), flatten(Vertices)
ma = MassAddition(Input=len)  # -> Result, PartialResults
panel = Panel(ma.Result)
len_2 = Length(Curve=explode.Segments)
bar_graph = BarGraph(len_2, BarColor=RGB(255, 0, 90))

# ---- group: 线荷载分段长度
len_3 = Length(Curve=explode.Segments)
division_2 = Division(A=len_3, B="2")
ins = InsertItems(List=division_2, Item="0", Indices="0", Wrap=True)
addition = Addition(A=simplify(division_2), B=simplify(ins))

# ----
crv_3 = Curve(item)
explode_2 = Explode(Curve=crv_3, Recursive=True)  # -> Segments, Vertices

curvepoint = PointOnCurve(explode_2.Segments, parameter=0.5)

# ----
# LOAD
材料密度 = Panel("8000")
end = EndPoints(Curve=crv)  # -> Start, End
anchorpt = Point(flatten([end.Start, end.End]))

# ---- group: 质量线密度
expression = Expression(D=D, t=t_2, rho=材料密度, Expression="rho*π*(D^2-(D-t*2)^2)/4")
multiplication = Multiplication(A="0.20", B="1")
addition_2 = Addition(A=expression, B=multiplication)
质量线密度 = Panel(addition_2)

# ---- group: 重力
重力荷载系数 = Panel("1.5")
expression_2 = Expression(x=addition, y=addition_2, weight=重力荷载系数, Expression="x*y*9.8*weight")
pt = Point(explode.Vertices)
Z = UnitZ(Factor=expr("-x", expression_2))
ma_2 = MassAddition(Input=flatten(expression_2))  # -> Result, PartialResults
panel_2 = Panel(ma_2.Result)
load = Load(Point=pt, ForceVector=Z, Weighting=1)
vdis = VectorDisplay(Anchor=pt, Vector=Z)

# ----
expression_3 = Expression(D=D, t=t_2, E=material_elasticity, Expression="E*π*(D^4-(D-t*2)^4)/64")
expression_4 = Expression(D=D, t=t_2, E=material_elasticity, Expression="E*π*(D^2-(D-t*2)^2)/4")
merge = Merge(Data1=crv_2)
rod = Rod(Polyline=crv, LengthFactor=1, AngleFactor="1", AxialStrength=expression_4, BendStrength=expression_3)  # -> flatten(R)
anchor = Anchor(Point=anchorpt, Strength=1e+10)
show = Show(G=merge)

duppt = RemoveDuplicatePts(Points=pt, Tolerance=0.01)
c_script = CSharpScript(Pts=flatten(duppt), Strength="1000", Reference="D:\Program Files\kangaroo242\KangarooSolver.dll")  # -> out, A; inputs Pts: list of Point3d, Strength: Double; disabled
# ---------- c_script: C# usings ----------
using KangarooSolver;
# ---------- c_script: C# ----------
    A = new Floor2(Pts, Strength);
# ---------- c_script: C# additional code ----------
  public class Floor2 : GoalObject
  {

    double Strength;

    public Floor2(List<Point3d> P, double k)
    {
      PPos = P.ToArray();
      Move = new Vector3d[P.Count];
      Weighting = new double[P.Count];
      Strength = k;
    }

    public override void Calculate(List<KangarooSolver.Particle> p)
    {
      for (int i = 0; i < PIndex.Length; i++)
      {
        double Height = p[i].Position.Z;
        if (Height < 0)
        {
          Move[i] = -Vector3d.ZAxis * Height;
          Weighting[i] = Strength;
        }
        else
        {
          Move[i] = Vector3d.Zero;
          Weighting[i] = 0;
        }

      }
    }

  }
# ---------- end c_script ----------
length_line = LengthLine(Strength=expression_4)
merge_2 = Merge(Data1=show, Data2=rod, Data3=anchor, Data4=length_line, Data6=c_script.A, Data7=load)

zombiesolver = ZombieSolver(GoalObjects=flatten(merge_2), Threshold="1e-14", Tolerance="1e-3", MaxIterations=50000)  # -> I, V, O
panel_3 = Panel(zombiesolver.I)

crv_4 = Curve(zombiesolver.O)
cp = ControlPoints(Curve=crv_4)  # -> Points, Weights, Knots
lng = ListLength(List=cp.Points)
larger = LargerThan(FirstNumber=lng, SecondNumber="2")  # -> flatten(LargerThan), OrEqualTo
dispatch = Dispatch(List=crv_4, DispatchPattern=larger.LargerThan)  # -> ListA, ListB
explode_3 = Explode(Curve=dispatch.ListA, Recursive=True)  # -> Segments, Vertices

# ---- group: Displacement
curvepoint_2 = PointOnCurve(explode_3.Segments, parameter=0.5)
dist = Distance(PointA=curvepoint, PointB=curvepoint_2)  # -> flatten(Distance)
bnd = Bounds(Numbers=dist)
dedomain = DeconstructDomain(Domain=bnd)  # -> Start, End
multiplication_2 = Multiplication(A=dedomain.End, B=Slider(0.867, range=0..1))
gradient = Gradient(
    LowerLimit=dedomain.Start,
    UpperLimit=multiplication_2,
    Parameter=dist,
    stops=[0: RGB(75, 0, 130), 0.112: RGB(39, 72, 161), 0.259: RGB(1, 192, 229), 0.394: RGB(18, 178, 90), 0.549: RGB(79, 186, 8), 0.696: RGB(220, 237, 32), 0.845: RGB(247, 159, 20), 1: RGB(242, 0, 0)])
bar_graph_2 = BarGraph(dist, BarColor=RGB(255, 0, 90))

# ----
data = Data(dedomain.End)
data_2 = Data(gradient)
crv_5 = Curve(explode_3.Segments)
data_3 = ClusterOutput(data)
data_4 = ClusterOutput(data_2)
crv_6 = ClusterOutput(crv_5)

# ==== cluster Relaxation
relay = ClusterInput()

# ----
# Relaxation
number_slider = Slider(0.99, range=0..1)
end = EndPoints(Curve=relay)  # -> Start, End
rod = Rod(Polyline=relay, LengthFactor=number_slider, AngleFactor="0", AxialStrength=Slider(100, range=0..1000), BendStrength=1)
anchor = Anchor(Point=[end.Start, end.End], Strength=Slider(10000, range=0..10000))
show = Show(G=relay)

relay_2 = Relay([show, rod, anchor])
zombiesolver = ZombieSolver(GoalObjects=relay_2, Threshold="10e-18", Tolerance="10e-6", MaxIterations=Slider(100000, range=0..100000))  # -> I, V, O

panel = Panel(zombiesolver.I)
clean = CleanTree(RemoveNulls=True, RemoveInvalid=True, RemoveEmpty=False, Tree=zombiesolver.O)
cp = ControlPoints(Curve=clean)  # -> Points, Weights, Knots
lng = ListLength(List=cp.Points)
larger = LargerThan(FirstNumber=lng, SecondNumber="3")  # -> LargerThan, OrEqualTo
dispatch = Dispatch(List=clean, DispatchPattern=flatten(larger.OrEqualTo))  # -> ListA, ListB
crv = Curve(dispatch.ListA)

crv_2 = ClusterOutput(crv)

# ==== cluster Cluster_2
relay = ClusterInput()
i = ClusterInput()
item = ListItem(List=relay, Index=i, Wrap=True)

# ---- group: Rod
crv = Curve(flatten(item))

# ---- group: FRP截面尺寸
t = Slider(0.005, range=0..0.1)
D = Slider(0.05, range=0..0.1)
division = Division(A=D, B="2")
t_2 = Number(t)

# ----
crv_2 = Curve(crv)

gfrp = Panel("2.5E10")
material_elasticity = Panel(gfrp)

# ---- group: RODs Geometry
len = Length(Curve=crv_2)
explode = Explode(Curve=crv_2, Recursive=True)  # -> flatten(Segments), flatten(Vertices)
ma = MassAddition(Input=len)  # -> Result, PartialResults
panel = Panel(ma.Result)
len_2 = Length(Curve=explode.Segments)
bar_graph = BarGraph(len_2, BarColor=RGB(255, 0, 90))

# ---- group: 线荷载分段长度
len_3 = Length(Curve=explode.Segments)
division_2 = Division(A=len_3, B="2")
ins = InsertItems(List=division_2, Item="0", Indices="0", Wrap=True)
addition = Addition(A=simplify(division_2), B=simplify(ins))

# ----
crv_3 = Curve(item)
explode_2 = Explode(Curve=crv_3, Recursive=True)  # -> Segments, Vertices

curvepoint = PointOnCurve(explode_2.Segments, parameter=0.5)

# ----
# LOAD
材料密度 = Panel("8000")
end = EndPoints(Curve=crv)  # -> Start, End
anchorpt = Point(flatten([end.Start, end.End]))

# ---- group: 质量线密度
expression = Expression(D=D, t=t_2, rho=材料密度, Expression="rho*π*(D^2-(D-t*2)^2)/4")
multiplication = Multiplication(A="0.20", B="1")
addition_2 = Addition(A=expression, B=multiplication)
质量线密度 = Panel(addition_2)

# ---- group: 重力
重力荷载系数 = Panel("1.5")
expression_2 = Expression(x=addition, y=addition_2, weight=重力荷载系数, Expression="x*y*9.8*weight")
pt = Point(explode.Vertices)
Z = UnitZ(Factor=expr("-x", expression_2))
ma_2 = MassAddition(Input=flatten(expression_2))  # -> Result, PartialResults
panel_2 = Panel(ma_2.Result)
load = Load(Point=pt, ForceVector=Z, Weighting=1)
vdis = VectorDisplay(Anchor=pt, Vector=Z)

# ----
expression_3 = Expression(D=D, t=t_2, E=material_elasticity, Expression="E*π*(D^4-(D-t*2)^4)/64")
expression_4 = Expression(D=D, t=t_2, E=material_elasticity, Expression="E*π*(D^2-(D-t*2)^2)/4")
merge = Merge(Data1=crv_2)
rod = Rod(Polyline=crv, LengthFactor=1, AngleFactor="1", AxialStrength=expression_4, BendStrength=expression_3)  # -> flatten(R)
anchor = Anchor(Point=anchorpt, Strength=1e+10)
show = Show(G=merge)

duppt = RemoveDuplicatePts(Points=pt, Tolerance=0.01)
c_script = CSharpScript(Pts=flatten(duppt), Strength="1000", Reference="D:\PROGRAM FILES\KANGAROO242\KangarooSolver.dll")  # -> out, A; inputs Pts: list of Point3d, Strength: Double; disabled; same code as c_script
length_line = LengthLine(Strength=expression_4)
merge_2 = Merge(Data1=show, Data2=rod, Data3=anchor, Data4=length_line, Data6=c_script.A, Data7=load)

zombiesolver = ZombieSolver(GoalObjects=flatten(merge_2), Threshold="1e-14", Tolerance="1e-3", MaxIterations=50000)  # -> I, V, O
panel_3 = Panel(zombiesolver.I)

crv_4 = Curve(zombiesolver.O)
cp = ControlPoints(Curve=crv_4)  # -> Points, Weights, Knots
lng = ListLength(List=cp.Points)
larger = LargerThan(FirstNumber=lng, SecondNumber="2")  # -> flatten(LargerThan), OrEqualTo
dispatch = Dispatch(List=crv_4, DispatchPattern=larger.LargerThan)  # -> ListA, ListB
explode_3 = Explode(Curve=dispatch.ListA, Recursive=True)  # -> Segments, Vertices

# ---- group: Displacement
curvepoint_2 = PointOnCurve(explode_3.Segments, parameter=0.5)
dist = Distance(PointA=curvepoint, PointB=curvepoint_2)  # -> flatten(Distance)
bnd = Bounds(Numbers=dist)
dedomain = DeconstructDomain(Domain=bnd)  # -> Start, End
multiplication_2 = Multiplication(A=dedomain.End, B=Slider(0.867, range=0..1))
gradient = Gradient(
    LowerLimit=dedomain.Start,
    UpperLimit=multiplication_2,
    Parameter=dist,
    stops=[0: RGB(75, 0, 130), 0.112: RGB(39, 72, 161), 0.259: RGB(1, 192, 229), 0.394: RGB(18, 178, 90), 0.549: RGB(79, 186, 8), 0.696: RGB(220, 237, 32), 0.845: RGB(247, 159, 20), 1: RGB(242, 0, 0)])
bar_graph_2 = BarGraph(dist, BarColor=RGB(255, 0, 90))

# ----
data = Data(dedomain.End)
data_2 = Data(gradient)
crv_5 = Curve(explode_3.Segments)
data_3 = ClusterOutput(data)
data_4 = ClusterOutput(data_2)
crv_6 = ClusterOutput(crv_5)

# ==== cluster SimWFloor
crv = ClusterInput()
crv_2 = Curve(crv)

# ---- group: Rod
crv_3 = Curve(flatten(crv_2))

# ---- group: FRP截面尺寸
t = Slider(0.005, range=0..0.1)
D = Slider(0.05, range=0..0.1)
division = Division(A=D, B="2")
t_2 = Number(t)

# ----
crv_4 = Curve(crv_3)

gfrp = Panel("2.5E10")
material_elasticity = Panel(gfrp)

# ---- group: RODs Geometry
len = Length(Curve=crv_4)
explode = Explode(Curve=crv_4, Recursive=True)  # -> flatten(Segments), flatten(Vertices)
ma = MassAddition(Input=len)  # -> Result, PartialResults
panel = Panel(ma.Result)
len_2 = Length(Curve=explode.Segments)
bar_graph = BarGraph(len_2, BarColor=RGB(255, 0, 90))

# ---- group: 线荷载分段长度
len_3 = Length(Curve=explode.Segments)
division_2 = Division(A=len_3, B="2")
ins = InsertItems(List=division_2, Item="0", Indices="0", Wrap=True)
addition = Addition(A=simplify(division_2), B=simplify(ins))

# ----
# LOAD
材料密度 = Panel("8000")
end = EndPoints(Curve=crv_3)  # -> Start, End
anchorpt = Point(flatten([end.Start, end.End]))

# ---- group: 质量线密度
expression = Expression(D=D, t=t_2, rho=材料密度, Expression="rho*π*(D^2-(D-t*2)^2)/4")
multiplication = Multiplication(A="0.20", B="1")
addition_2 = Addition(A=expression, B=multiplication)
质量线密度 = Panel(addition_2)

# ---- group: 重力
重力荷载系数 = Panel("1.5")
expression_2 = Expression(x=addition, y=addition_2, weight=重力荷载系数, Expression="x*y*9.8*weight")
pt = Point(explode.Vertices)
Z = UnitZ(Factor=expr("-x", expression_2))
ma_2 = MassAddition(Input=flatten(expression_2))  # -> Result, PartialResults
panel_2 = Panel(ma_2.Result)
load = Load(Point=pt, ForceVector=Z, Weighting=1)
vdis = VectorDisplay(Anchor=pt, Vector=Z)

# ----
expression_3 = Expression(D=D, t=t_2, E=material_elasticity, Expression="E*π*(D^4-(D-t*2)^4)/64")
expression_4 = Expression(D=D, t=t_2, E=material_elasticity, Expression="E*π*(D^2-(D-t*2)^2)/4")
merge = Merge(Data1=crv_4)
rod = Rod(Polyline=crv_3, LengthFactor=1, AngleFactor="1", AxialStrength=expression_4, BendStrength=expression_3)  # -> flatten(R)
anchor = Anchor(Point=anchorpt, Strength=1e+10)
show = Show(G=merge)

duppt = RemoveDuplicatePts(Points=pt, Tolerance=0.01)
c_script = CSharpScript(Pts=flatten(duppt), Strength="1000", Reference="D:\PROGRAM FILES\KANGAROO242\KangarooSolver.dll")  # -> out, A; inputs Pts: list of Point3d, Strength: Double; disabled; same code as c_script
length_line = LengthLine(Strength=expression_4)
merge_2 = Merge(Data1=show, Data2=rod, Data3=anchor, Data4=length_line, Data6=c_script.A, Data7=load)

zombiesolver = ZombieSolver(GoalObjects=flatten(merge_2), Threshold="1e-14", Tolerance="1e-3", MaxIterations=50000)  # -> I, V, O
panel_3 = Panel(zombiesolver.I)

crv_5 = Curve(merge)
explode_2 = Explode(Curve=crv_5, Recursive=True)  # -> Segments, Vertices

crv_6 = Curve(zombiesolver.O)
cp = ControlPoints(Curve=crv_6)  # -> Points, Weights, Knots
lng = ListLength(List=cp.Points)
larger = LargerThan(FirstNumber=lng, SecondNumber="2")  # -> flatten(LargerThan), OrEqualTo
curvepoint = PointOnCurve(explode_2.Segments, parameter=0.5)
dispatch = Dispatch(List=crv_6, DispatchPattern=larger.LargerThan)  # -> ListA, ListB
explode_3 = Explode(Curve=dispatch.ListA, Recursive=True)  # -> Segments, Vertices

# ---- group: Displacement
curvepoint_2 = PointOnCurve(explode_3.Segments, parameter=0.5)
dist = Distance(PointA=curvepoint, PointB=curvepoint_2)  # -> flatten(Distance)
bnd = Bounds(Numbers=dist)
dedomain = DeconstructDomain(Domain=bnd)  # -> Start, End
multiplication_2 = Multiplication(A=dedomain.End, B=Slider(0.867, range=0..1))
gradient = Gradient(
    LowerLimit=dedomain.Start,
    UpperLimit=multiplication_2,
    Parameter=dist,
    stops=[0: RGB(75, 0, 130), 0.112: RGB(39, 72, 161), 0.259: RGB(1, 192, 229), 0.394: RGB(18, 178, 90), 0.549: RGB(79, 186, 8), 0.696: RGB(220, 237, 32), 0.845: RGB(247, 159, 20), 1: RGB(242, 0, 0)])
bar_graph_2 = BarGraph(dist, BarColor=RGB(255, 0, 90))

# ----
data = Data(dedomain.End)
crv_7 = Curve(explode_3.Segments)
data_2 = Data(gradient)
data_3 = ClusterOutput(data)
crv_8 = ClusterOutput(crv_7)
data_4 = ClusterOutput(data_2)
